# Grasshopper definition PI_Example_ModuleAggGr.gh (Grasshopper 1.0.7)

get_integer = GetInteger(Slider(25, range=1..60), AtLeast=1, AtMost=1, Maximum=2147483647, Minimum=-2147483648)
subd = SubD(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)
brep = Brep(subd)
deconstruct_brep = DeconstructBrep(Brep=brep)  # -> Faces, Edges, Vertices
expression = Expression(x=get_integer, Expression="if(x>12,2.00,1.00)")
entwine = Entwine(Branch00=expression, FlattenInputs=True)
panel = Panel(entwine)
larger_than = LargerThan(FirstNumber=panel, SecondNumber="0.99")  # -> LargerThan, OrEqualTo
expression_2 = Expression(x=get_integer, Expression="if(x≥24,52,0)")
dispatch = Dispatch(List=panel, DispatchPattern=larger_than.LargerThan)  # -> ListA, ListB
panel_2 = Panel(dispatch.ListA)
area = Area(Geometry=subd)  # -> Area, Centroid
absolute = Absolute(Value=flatten(panel_2))
expression_3 = Expression(x=absolute, Expression="if(x=2,51,0)")
entwine_2 = Entwine(Branch00=expression_3, Branch01=expression_2, FlattenInputs=True)
panel_3 = Panel(entwine_2)
scale = Scale(Geometry=subd, Center=area.Centroid, Factor=absolute)  # -> Geometry, Transform
larger_than_2 = LargerThan(FirstNumber=panel_3, SecondNumber="1")  # -> LargerThan, OrEqualTo
dispatch_2 = Dispatch(List=panel_3, DispatchPattern=larger_than_2.LargerThan)  # -> ListA, ListB
deconstruct_brep_2 = DeconstructBrep(Brep=scale.Geometry)  # -> Faces, Edges, Vertices
area_2 = Area(Geometry=scale.Geometry)  # -> Area, Centroid
panel_4 = Panel(dispatch_2.ListA)
cull_index = CullIndex(List=deconstruct_brep_2.Faces, Indices=flatten(panel_4), Wrap=True)

number_slider = Slider(1.1, range=1..1.35)
area_3 = Area(Geometry=cull_index)  # -> Area, Centroid
scale_2 = Scale(Geometry=area_3.Centroid, Center=area_2.Centroid, Factor=number_slider)  # -> Geometry, Transform
extrude_point = ExtrudePoint(Base=cull_index, Point=scale_2.Geometry)
number_slider_2 = Slider(0.03, range=0..0.1)
brep_edges = BrepEdges(Brep=extrude_point)  # -> Naked, flatten(Interior), NonManifold
pipe = Pipe(Curve=brep_edges.Interior, Radius=number_slider_2, Caps=0)

explode_tree = ExplodeTree(Data=panel_4)  # -> Branch0, Branch1, Branch2, Branch3
list_item = ListItem(List=deconstruct_brep_2.Faces, Index=flatten(explode_tree.Branch0), Wrap=True)
list_item_2 = ListItem(List=deconstruct_brep_2.Faces, Index=flatten(explode_tree.Branch1), Wrap=True)
area_4 = Area(Geometry=subd)  # -> Area, Centroid
area_5 = Area(Geometry=list_item)  # -> Area, Centroid
area_6 = Area(Geometry=subd)  # -> Area, Centroid
area_7 = Area(Geometry=list_item_2)  # -> Area, Centroid
expression_4 = Expression(x=get_integer, Expression="if(x>24,2.00,1.00)")
expression_5 = Expression(x=get_integer, Expression="if(x>36,2.00,1.00)")
line = Line(StartPoint=area_4.Centroid, EndPoint=area_5.Centroid)
amplitude = Amplitude(Vector=line, Amplitude=Slider(10, range=0..10))
move = Move(Geometry=subd, Motion=amplitude)  # -> Geometry, Transform
entwine_3 = Entwine(Branch00=expression_4, FlattenInputs=True)
entwine_4 = Entwine(Branch00=expression_5, FlattenInputs=True)
line_2 = Line(StartPoint=area_6.Centroid, EndPoint=area_7.Centroid)
panel_5 = Panel(entwine_3)
panel_6 = Panel(entwine_4)
amplitude_2 = Amplitude(Vector=line_2, Amplitude=Slider(8.9, range=0..10))
move_2 = Move(Geometry=subd, Motion=amplitude_2)  # -> Geometry, Transform
larger_than_3 = LargerThan(FirstNumber=panel_5, SecondNumber="0.99")  # -> LargerThan, OrEqualTo
larger_than_4 = LargerThan(FirstNumber=panel_6, SecondNumber="0.99")  # -> LargerThan, OrEqualTo
dispatch_3 = Dispatch(List=panel_5, DispatchPattern=larger_than_3.LargerThan)  # -> ListA, ListB
dispatch_4 = Dispatch(List=panel_6, DispatchPattern=larger_than_4.LargerThan)  # -> ListA, ListB
panel_7 = Panel(dispatch_3.ListA)
panel_8 = Panel(dispatch_4.ListA)
area_8 = Area(Geometry=move.Geometry)  # -> Area, Centroid
absolute_2 = Absolute(Value=flatten(panel_7))
expression_6 = Expression(x=absolute_2, Expression="if(x=2,50,0)")
expression_7 = Expression(x=absolute_2, Expression="if(x=1,50,0)")
area_9 = Area(Geometry=move_2.Geometry)  # -> Area, Centroid
entwine_5 = Entwine(Branch00=expression_7, Branch01=expression_6, FlattenInputs=True)
absolute_3 = Absolute(Value=flatten(panel_8))
expression_8 = Expression(x=absolute_3, Expression="if(x=2,53,0)")
expression_9 = Expression(x=absolute_3, Expression="if(x=1,53,0)")
scale_3 = Scale(Geometry=move.Geometry, Center=area_8.Centroid, Factor=absolute_2)  # -> Geometry, Transform
entwine_6 = Entwine(Branch00=expression_9, Branch01=expression_8, FlattenInputs=True)
panel_9 = Panel(entwine_5)
scale_4 = Scale(Geometry=move_2.Geometry, Center=area_9.Centroid, Factor=absolute_3)  # -> Geometry, Transform
panel_10 = Panel(entwine_6)
larger_than_5 = LargerThan(FirstNumber=panel_9, SecondNumber="1")  # -> LargerThan, OrEqualTo
area_10 = Area(Geometry=scale_3.Geometry)  # -> Area, Centroid
larger_than_6 = LargerThan(FirstNumber=panel_10, SecondNumber="1")  # -> LargerThan, OrEqualTo
deconstruct_brep_3 = DeconstructBrep(Brep=scale_3.Geometry)  # -> Faces, Edges, Vertices
dispatch_5 = Dispatch(List=panel_9, DispatchPattern=larger_than_5.LargerThan)  # -> ListA, ListB
deconstruct_brep_4 = DeconstructBrep(Brep=scale_4.Geometry)  # -> Faces, Edges, Vertices
dispatch_6 = Dispatch(List=panel_10, DispatchPattern=larger_than_6.LargerThan)  # -> ListA, ListB
panel_11 = Panel(dispatch_5.ListA)
list_item_3 = ListItem(List=deconstruct_brep_3.Faces, Index=flatten(panel_11), Wrap=True)
area_11 = Area(Geometry=scale_4.Geometry)  # -> Area, Centroid
cull_index_2 = CullIndex(List=deconstruct_brep_3.Faces, Indices=flatten(panel_11), Wrap=True)

area_12 = Area(Geometry=cull_index_2)  # -> Area, Centroid
scale_5 = Scale(Geometry=area_12.Centroid, Center=area_10.Centroid, Factor=number_slider)  # -> Geometry, Transform
extrude_point_2 = ExtrudePoint(Base=cull_index_2, Point=scale_5.Geometry)
brep_edges_2 = BrepEdges(Brep=extrude_point_2)  # -> Naked, flatten(Interior), NonManifold
pipe_2 = Pipe(Curve=brep_edges_2.Interior, Radius=number_slider_2, Caps=0)

panel_12 = Panel(dispatch_6.ListA)
cull_index_3 = CullIndex(List=deconstruct_brep_4.Faces, Indices=flatten(panel_12), Wrap=True)
list_item_4 = ListItem(List=deconstruct_brep_4.Faces, Index=flatten(panel_12), Wrap=True)

area_13 = Area(Geometry=cull_index_3)  # -> Area, Centroid
scale_6 = Scale(Geometry=area_13.Centroid, Center=area_11.Centroid, Factor=number_slider)  # -> Geometry, Transform
extrude_point_3 = ExtrudePoint(Base=cull_index_3, Point=scale_6.Geometry)
brep_edges_3 = BrepEdges(Brep=extrude_point_3)  # -> Naked, flatten(Interior), NonManifold
pipe_3 = Pipe(Curve=brep_edges_3.Interior, Radius=number_slider_2, Caps=0)

curve = Curve(list_item)
curve_2 = Curve(list_item_3)
explode = Explode(Curve=curve, Recursive=True)  # -> Segments, Vertices
explode_2 = Explode(Curve=curve_2, Recursive=True)  # -> Segments, Vertices
curve_middle = CurveMiddle(Curve=explode.Segments)
curve_middle_2 = CurveMiddle(Curve=explode_2.Segments)
interpolate = Interpolate(Vertices=curve_middle, Degree=3, Periodic=True, KnotStyle=1)  # -> Curve, Length, Domain
interpolate_2 = Interpolate(Vertices=curve_middle_2, Degree=3, Periodic=True, KnotStyle=1)  # -> Curve, Length, Domain
patch = Patch(Curves=[curve, interpolate.Curve], Spans=20, Flexibility=1, Trim=True)
patch_2 = Patch(Curves=[curve_2, interpolate_2.Curve], Spans=20, Flexibility=1, Trim=True)
area_14 = Area(Geometry=interpolate_2.Curve)  # -> Area, Centroid
area_15 = Area(Geometry=interpolate.Curve)  # -> Area, Centroid
line_3 = Line(StartPoint=area_14.Centroid, EndPoint=area_15.Centroid)
pipe_4 = Pipe(Curve=line_3, Radius=1, Caps=0)
pipe_5 = Pipe(Curve=[interpolate_2.Curve, interpolate.Curve], Radius=Slider(0.04, range=0..0.1), Caps=0)

curve_3 = Curve(list_item_2)
curve_4 = Curve(list_item_4)
explode_3 = Explode(Curve=curve_3, Recursive=True)  # -> Segments, Vertices
explode_4 = Explode(Curve=curve_4, Recursive=True)  # -> Segments, Vertices
curve_middle_3 = CurveMiddle(Curve=explode_3.Segments)
curve_middle_4 = CurveMiddle(Curve=explode_4.Segments)
interpolate_3 = Interpolate(Vertices=curve_middle_3, Degree=3, Periodic=True, KnotStyle=1)  # -> Curve, Length, Domain
interpolate_4 = Interpolate(Vertices=curve_middle_4, Degree=3, Periodic=True, KnotStyle=1)  # -> Curve, Length, Domain
patch_3 = Patch(Curves=[curve_3, interpolate_3.Curve], Spans=20, Flexibility=1, Trim=True)
patch_4 = Patch(Curves=[curve_4, interpolate_4.Curve], Spans=20, Flexibility=1, Trim=True)
area_16 = Area(Geometry=interpolate_4.Curve)  # -> Area, Centroid
area_17 = Area(Geometry=interpolate_3.Curve)  # -> Area, Centroid
line_4 = Line(StartPoint=area_16.Centroid, EndPoint=area_17.Centroid)
pipe_6 = Pipe(Curve=line_4, Radius=1, Caps=0)
pipe_7 = Pipe(Curve=[interpolate_4.Curve, interpolate_3.Curve], Radius=Slider(0.04, range=0..0.1), Caps=0)
